# Grasshopper definition 1.gh (Grasshopper 1.0.5)
# plug-ins: Barnacle

value_list = ValueList({"Zero": 0, "One": 1, "Two": 2, "Three": 2² - 1, "Four": Sqrt(16)}, selected="Zero")
point = Point([Point(248.576839, -90, 0), Point(179.7195664, -88.75369393, 0), Point(250.4164688, -49.6439516, 0), Point(180.8274694, -54.68039353, 0)])
list_item = ListItem(List=point, Index=0, Wrap=True)  # -> Item, Item1, Item2, Item3
barnacle = Barnacle(PointA=list_item.Item, PointB=list_item.Item1, PointC=list_item.Item2, PointD=list_item.Item3, TopIResult=value_list)  # -> Result, Log
barnacle_2 = Barnacle()  # -> Result, Log
panel = Panel(barnacle.Log)
